# Dynamo graph 00 Truss - Simple.dyn (Dynamo 0.8.1.1942)

# group: Line input
byCoordinates = Point.ByCoordinates()
number_slider = DoubleSlider(27.191, range=10..40 step 0.1)
byCoordinates_2 = Point.ByCoordinates(y=number_slider)
byStartPointEndPoint = Line.ByStartPointEndPoint(startPoint=byCoordinates, endPoint=byCoordinates_2)

# group: Number of cells
number_of_cells = DoubleSlider(6, range=0..20 step 1)

code_block = CodeBlock(numCells=number_of_cells) { 0..1..#(numCells+1); }
# note: Bottom points
pointAtParameter = Curve.PointAtParameter(curve=byStartPointEndPoint, param=code_block)
byPoints = PolyCurve.ByPoints(points=pointAtParameter)
# note: Break apart the polyCurves because we only want to send line segments to Revit.
explode = Geometry.Explode(byPoints)

# group: Truss height
height = DoubleSlider(5, range=0..10 step 0.1)

byCoordinates_3 = Vector.ByCoordinates(z=height)
# note: Top points
translate = Geometry.Translate(geometry=pointAtParameter, direction=byCoordinates_3)
byStartPointEndPoint_2 = Line.ByStartPointEndPoint(startPoint=pointAtParameter, endPoint=translate)
byPoints_2 = PolyCurve.ByPoints(points=translate)
explode_2 = Geometry.Explode(byPoints_2)
code_block_2 = CodeBlock { -1; }
shiftIndices = List.ShiftIndices(list=translate, amount=code_block_2)
byStartPointEndPoint_3 = Line.ByStartPointEndPoint(startPoint=pointAtParameter, endPoint=shiftIndices)
takeItems = List.TakeItems(list=byStartPointEndPoint_3, amount=number_of_cells)
create = List.Create(explode, byStartPointEndPoint_2, explode_2, takeItems)
flatten = Flatten(create)
makeATruss = Custom[MakeATruss]()  # makes lines for a truss from a base curve
