# Dynamo graph 02 Truss - Custom Node.dyn (Dynamo 0.8.1.1942)

# group: Line input
byCoordinates = Point.ByCoordinates()
number_slider = DoubleSlider(27.191, range=10..40 step 0.1)
byCoordinates_2 = Point.ByCoordinates(y=number_slider)
byStartPointEndPoint = Line.ByStartPointEndPoint(startPoint=byCoordinates, endPoint=byCoordinates_2)

# group: Truss height
height = DoubleSlider(5, range=0..10 step 0.1)

# group: Number of cells
number_of_cells = DoubleSlider(6, range=0..20 step 1)

dynamoTutorial_Truss = Custom[DynamoTutorial_Truss](baseCurve=byStartPointEndPoint, height=height, cells=number_of_cells)  # Draw lines for a truss form
