# Dynamo graph 03 Truss - Apply to surfaces.dyn (Dynamo 0.8.1.1942)

# note: Select a single face from a Revit element.  This returns a list because some faces in Revit are composed of multiple surfaces (as in where two walls meet).
# note: Use this with the sample file ApplyTrusses.rvt
select_face = DSFaceSelection()  # 1 picked in the model
firstItem = List.FirstItem(select_face)

# group: Extract isocurves from the surface to form the base curves for the truss.
code_block = CodeBlock { 0..1..#6; }
getIsoline = Surface.GetIsoline(firstItem, arg2=code_block)
code_block_2 = CodeBlock { -5; 8; }
dynamoTutorial_Truss = Custom[DynamoTutorial_Truss](baseCurve=getIsoline, height=code_block_2.out0, cells=code_block_2.out1)  # Draw lines for a truss form

select_model_element = DSModelElementSelection()  # 1 picked in the model

# group: Of all the geometry that the element may contain, choose the first one.
geometry = Element.Geometry(select_model_element)
firstItem_2 = List.FirstItem(geometry)

explode = Geometry.Explode(firstItem_2)

# group: Get the lowest surface from the solid by sorting the surfaces according to the z-coordinate of their center point.
code_block_3 = CodeBlock { 0.5; }
pointAtParameter = Surface.PointAtParameter(surface=explode, u=code_block_3, v=code_block_3)
Z = Point.Z(pointAtParameter)
sortByKey = Custom[List.SortByKey](list=explode, keys=Z)  # Sort a list (or lists) according to the order specified by the key list.
firstItem_3 = List.FirstItem(sortByKey.sorted_list)

# group: Extract isocurves from the surface to form the base curves for the truss.
code_block_4 = CodeBlock { 0..1..#6; }
getIsoline_2 = Surface.GetIsoline(firstItem_3, arg2=code_block_4)
code_block_5 = CodeBlock { -5; 8; }
# note: Notice that the way this surface was modeled in Revit, that it was "trimmed."  So some of the parameters of the surface are OFF of the surface.  To make these trusses appear in a different way, we will need different logic to construct the base curves.
dynamoTutorial_Truss_2 = Custom[DynamoTutorial_Truss](baseCurve=getIsoline_2, height=code_block_5.out0, cells=code_block_5.out1)

select_model_element_2 = DSModelElementSelection()  # 1 picked in the model

# group: Of all the geometry that the element may contain, choose the first one.
geometry_2 = Element.Geometry(select_model_element_2)
firstItem_4 = List.FirstItem(geometry_2)

explode_2 = Geometry.Explode(firstItem_4)

# group: Get the lowest surface from the solid by sorting the surfaces according to the z-coordinate of their center point.
code_block_6 = CodeBlock { 0.5; }
pointAtParameter_2 = Surface.PointAtParameter(surface=explode_2, u=code_block_6, v=code_block_6)
Z_2 = Point.Z(pointAtParameter_2)
sortByKey_2 = Custom[List.SortByKey](list=explode_2, keys=Z_2)
firstItem_5 = List.FirstItem(sortByKey_2.sorted_list)

# group: Extract isocurves from the surface to form the base curves for the truss.
code_block_7 = CodeBlock { 0..1..#6; }
getIsoline_3 = Surface.GetIsoline(firstItem_5, arg2=code_block_7)
code_block_8 = CodeBlock { -5; 8; }
# note: This surface is more obviously trimmed with the whole through it.  See if you can construct trusses that do not cross the cutout.
dynamoTutorial_Truss_3 = Custom[DynamoTutorial_Truss](baseCurve=getIsoline_3, height=code_block_8.out0, cells=code_block_8.out1)

# group: Connect the curves to this node to use them as a framework to place structural elements in Revit.
levels = Levels("Level 2")
structural_framing_types = StructuralFramingTypes("W12X26")
beamByCurve = StructuralFraming.BeamByCurve(arg1=levels, arg2=structural_framing_types)
