# Dynamo graph Curvy surface.dyn (Dynamo 0.8.1.1942)

amplitude = DoubleSlider(6.12, range=0..10 step 0.01)
code_block = CodeBlock(amplitude=amplitude)
# ---------- code_block.designscript (14 lines) ----------
// Make a surface
min = -20;
max = 20;

x = min..max..#9;
z1 = amplitude * Math.Sin((360/(max-min))*(x+min));
z2 = amplitude * Math.Sin((360/(max-min))*(x));

pts1 = Point.ByCoordinates(x,min,z1);
pts2 = Point.ByCoordinates(x,(min + (max-min)/2),z2);
pts3 = Point.ByCoordinates(x,max,z1);

crvs = NurbsCurve.ByPoints({pts1,pts2,pts3});
Surface.ByLoft(crvs);
# ----------------------------------------
byGeometries = ImportInstance.ByGeometries(code_block.out9)
