# Dynamo graph 00 AC Truss - By Parameters.dyn (Dynamo 0.8.1.1942)

# group: Select one curve from Revit
# note: Run this graph with DynamoSample_2015.rvt in the Samples folder.
# Nodes grouped into blue groups communicate with Revit and come from the Revit library.  Other nodes come from the core and geometry libraries.
select_model_element = DSModelElementSelection()  # 1 picked in the model

# group: Select one curve from Revit
select_model_element_2 = DSModelElementSelection()  # 1 picked in the model

# group: Select one curve from Revit
select_model_element_3 = DSModelElementSelection()  # 1 picked in the model

create_list = List.Create(select_model_element, select_model_element_2, select_model_element_3)

# group: Get the curve from the model lines.
curve = CurveElement.Curve(create_list)

# note: Choose how many trusses to place.
integer_slider = IntegerSlider(9, range=2..10 step 1)
# note: For more on series syntax, see Help/Samples/Core/CoreRangeSyntax
code_block = CodeBlock(x=integer_slider) { 0..1..#x; }
pointAtParameter = Curve.PointAtParameter(curve=curve, param=code_block, lacing=CrossProduct)
# note: Swap the rows and columns
# of the 2-D, nested list.
transpose = Transpose(pointAtParameter)

# group: Choose which type of family to place. The first 3 are 3-point adaptive components which will work with this logic.
family_types = FamilyTypes("3PointAC_SquareTruss:3PointAC_SquareTruss")

# group: Place the adaptive components in the project
byPoints = AdaptiveComponent.ByPoints(transpose, family_types)
