# Dynamo graph 01 List Mapping.dyn (Dynamo 0.8.1.1942)

code_block = CodeBlock { x = 2..5; 1..x; }
watch = Watch(code_block.out1)

# group: How many items in the list?
# note: Without mapping, List.Count (and every other node) will act on the outer-most level of the list.  The first level of the list contains 5 elements (each of which is actually also a list).
count = List.Count(watch)

watch_2 = Watch(count)

# group: How many items in the list?
count_2 = List.Count()

# group: ...in EACH list
# note: When you map List.Count, you act one level down in the list.  You do "THIS to EACH OF these things..."
# Now List.Count reports the number of items in each of the lists located at one level down.
map = List.Map(list=watch, f_x=count_2)

watch_3 = Watch(map)
code_block_2 = CodeBlock { -25..#3..5; 0..#5..5; }
byCoordinates = Point.ByCoordinates(x=code_block_2.out0, y=code_block_2.out1, lacing=CrossProduct)
# note: Using cross product lacing creates a grid of points, which appears in written form as a nested list.  Each item of the highest-level list is also a list.
# Think of this as a 2-dimensional array.  You need two pieces of information to find any one item, like an X-coordinate and a Y-coordinate for a point in a grid, or like a pair of indices such as pointList[0][2] to access a single item in this list.
watch_4 = Watch(byCoordinates)
code_block_3 = CodeBlock { 0..#3..5; 0..#5..5; }
byCoordinates_2 = Point.ByCoordinates(x=code_block_3.out0, y=code_block_3.out1, lacing=CrossProduct)

# group: Transpose
# note: Transposing the list is equivalent to swapping the row and column of the points in the grid.  This reorganizes your data.  Compare the list structures before and after this node.
transpose = List.Transpose(byCoordinates_2)

# note: Horizontal lines
byPoints = PolyCurve.ByPoints(points=transpose)
# note: Vertical lines
byPoints_2 = PolyCurve.ByPoints(points=byCoordinates_2)
code_block_4 = CodeBlock { 25..#3..5; 0..#5..5; }
byCoordinates_3 = Point.ByCoordinates(x=code_block_4.out0, y=code_block_4.out1, lacing=CrossProduct)

# group: Get the item at index 2
code_block_5 = CodeBlock { 2; }
getItemAtIndex = List.GetItemAtIndex(index=code_block_5)

# group: ... FROM EACH list
map_2 = List.Map(list=byCoordinates_3, f_x=getItemAtIndex)

# note: From the Ampersand package.
pentagram = Custom[Pentagram](centerPoint=map_2)  # Closed polycurve in the shape of a 5-pointed star.

# group: Get the item at index 2
code_block_6 = CodeBlock { 2; }
getItemAtIndex_2 = List.GetItemAtIndex(list=byCoordinates_3, index=code_block_6)

byCenterPointRadius = Circle.ByCenterPointRadius(centerPoint=getItemAtIndex_2)
