# Dynamo graph 02 AC Truss - By Planes.dyn (Dynamo 0.8.1.1942)

# note: Select curve from Revit
# note: Run this graph the DynamoSample.rvt file in the Samples folder.
# This method for placing 3-point adaptive component truss forms requires that the trusses be vertical, wheras the previous version did not.  Note the different logic used.
select_model_element = DSModelElementSelection()  # 1 picked in the model
select_model_element_2 = DSModelElementSelection()  # 1 picked in the model
select_model_element_3 = DSModelElementSelection()  # 1 picked in the model
create_list = List.Create(select_model_element, select_model_element_2, select_model_element_3)
curve = CurveElement.Curve(create_list)
integer_slider = IntegerSlider(9, range=2..20 step 1)
code_block = CodeBlock(x=integer_slider) { 0..1..#x; }

# group: Use the first curve, which is a striaght line, as a "control curve." Points and vertical plans arrayed along this line will be used to determin the intersection points on the other curves where the trusses should touch.
firstItem = List.FirstItem(curve)
pointAtParameter = Curve.PointAtParameter(curve=firstItem, param=code_block)
tangentAtParameter = Curve.TangentAtParameter(firstItem, code_block)
byOriginNormal = Plane.ByOriginNormal(origin=pointAtParameter, normal=tangentAtParameter)
intersect = Geometry.Intersect(geometry=byOriginNormal, other=curve, lacing=CrossProduct)

# group: This list manipulation technique will group the points in sets of three by "flattening" the unnecessary hiearchy inside the groups of intersections. Compare the list structure from the Geometry.Intersect node to the list structure after List.Map.
flatten = Flatten()
map = List.Map(list=intersect, f_x=flatten)

# group: Filter out any of the sets of points that contain fewer than 3 points total. This might occur if the model curves are misaligned.
count = List.Count()
map_2 = List.Map(list=map, f_x=count)
code_block_2 = CodeBlock(len=map_2) { len == 3; }
filterByBoolMask = List.FilterByBoolMask(list=map, mask=code_block_2)

family_types = FamilyTypes("3PointAC_SquareTruss:3PointAC_SquareTruss")
byPoints = AdaptiveComponent.ByPoints(filterByBoolMask.in, family_types)
