# Dynamo graph 00 Panels from Excel - Read Data.dyn (Dynamo 0.8.1.1942)

# group: Excel
# note: Navigate to PanelPoints.xlsx (if you have Excel installed) in your sample files.
file_path = Filename("C:\Users\mccronc\Desktop\RAW\_03 Working with tabular data\PanelPoints.xlsx")
fromPath = FileObject(file_path)  # "File.FromPath"
code_block = CodeBlock { "Sheet1"; }
readFromFile = Excel.ReadFromFile(file=fromPath, sheetName=code_block)

watch = Watch(readFromFile)

# group: CSV
# note: The method to read data from a csv file is similar.  Navigate to PanelPoints.csv
file_path_2 = Filename("C:\Users\mccronc\Desktop\RAW\_03 Working with tabular data\PanelPoints.csv")
fromPath_2 = FileObject(file_path_2)  # "File.FromPath"
readFromFile_2 = CSV.ReadFromFile(fromPath_2)

watch_2 = Watch(readFromFile_2)
