# Dynamo graph 01 Panels from Excel - Organize Lists.dyn (Dynamo 0.8.1.1942)

# group: Excel
# note: Navigate to PanelPoints.xlsx (if you have Excel installed) in your sample files.
file_path = Filename("C:\Users\mccronc\Desktop\RAW\_03 Working with tabular data\PanelPoints.xlsx")
fromPath = FileObject(file_path)  # "File.FromPath"
code_block = CodeBlock { "Sheet1"; }
readFromFile = Excel.ReadFromFile(file=fromPath, sheetName=code_block)

firstItem = List.FirstItem(readFromFile)

# group: Use the first row of the Excel file, which contains the column titles, to sketch out the logic you will use for the larger sets of data
code_block_2 = CodeBlock { 3; 1; }
takeEveryNthItem = List.TakeEveryNthItem(firstItem, code_block_2.out0, code_block_2.out1)
code_block_3 = CodeBlock { 3; 2; }
takeEveryNthItem_2 = List.TakeEveryNthItem(firstItem, code_block_3.out0, code_block_3.out1)
code_block_4 = CodeBlock { 3; 3; }
takeEveryNthItem_3 = List.TakeEveryNthItem(firstItem, code_block_4.out0, code_block_4.out1)

watch = Watch(takeEveryNthItem)
watch_2 = Watch(takeEveryNthItem_2)
watch_3 = Watch(takeEveryNthItem_3)
# note: All rows but the first row of data
restOfItems = List.RestOfItems(readFromFile)
# note: Remove the null values from the list, which result if an empty cell is read from the Excel file.
clean = List.Clean(list=restOfItems)

# group: Use the same logic that you used for the first row, but apply it to ALL rows with List.Map
code_block_5 = CodeBlock { 3; 1; }
takeEveryNthItem_4 = List.TakeEveryNthItem(arg1=code_block_5.out0, arg2=code_block_5.out1)
code_block_6 = CodeBlock { 3; 2; }
takeEveryNthItem_5 = List.TakeEveryNthItem(arg1=code_block_6.out0, arg2=code_block_6.out1)
code_block_7 = CodeBlock { 3; 3; }
takeEveryNthItem_6 = List.TakeEveryNthItem(arg1=code_block_7.out0, arg2=code_block_7.out1)

map = List.Map(list=clean, f_x=takeEveryNthItem_4)
map_2 = List.Map(list=clean, f_x=takeEveryNthItem_5)
map_3 = List.Map(list=clean, f_x=takeEveryNthItem_6)
byCoordinates = Point.ByCoordinates(x=map, y=map_2, z=map_3)

# group: CSV
# note: The method to read data from a csv file is similar.  Navigate to PanelPoints.csv
file_path_2 = Filename("C:\Users\mccronc\Desktop\RAW\_03 Working with tabular data\PanelPoints.csv")
fromPath_2 = FileObject(file_path_2)  # "File.FromPath"
readFromFile_2 = CSV.ReadFromFile(fromPath_2)
