# Dynamo graph 01 Node to Code START.dyn (Dynamo 0.8.1.1942)

# note: ATTRACTOR POINT
# Scripting 101.
# An attractor point is a quick way to make variation across a field of objects.  It works by creating a grid of objects that have some parameter determined by the distance between the object and a point that moves around.
# To visualize what's going on, move the two sliders that control the location of the attractor point.
number = DoubleInput(1..50..5)
byCoordinates = Point.ByCoordinates(x=number, y=number, lacing=CrossProduct)
flatten = Flatten(byCoordinates)
code_block = CodeBlock { 0; }
number_slider = DoubleSlider(28.67, range=-10..60 step 0.1)
number_slider_2 = DoubleSlider(11.501, range=-10..60 step 0.1)
# note: Attractor Point.  Move the input sliders to adjust the location of this point.
byCoordinates_2 = Point.ByCoordinates(x=number_slider, y=number_slider_2)
# note: Finds the distance between the attractor point and the base point of the cylinders
distanceTo = Geometry.DistanceTo(geometry=flatten, other=byCoordinates_2, lacing=Longest)
code_block_2 = CodeBlock(x=distanceTo) { x/2; }
byCoordinates_3 = Vector.ByCoordinates(x=code_block, y=code_block, z=code_block_2)
add = Point.Add(point=flatten, vectorToAdd=byCoordinates_3)
code_block_3 = CodeBlock(x=distanceTo) { x/15; }
byPointsRadius = Cylinder.ByPointsRadius(flatten, add, code_block_3)
