# Dynamo graph 01 Node to Code.dyn (Dynamo 0.8.1.1942)

# note: ATTRACTOR POINT
# Scripting 101.
# An attractor point is a quick way to make variation across a field of objects.  It works by creating a grid of objects that have some parameter determined by the distance between the object and a point that moves around.
# To visualize what's going on, move the two sliders that control the location of the attractor point.
number_slider = DoubleSlider(28.67, range=-10..60 step 0.1)
number_slider_2 = DoubleSlider(11.501, range=-10..60 step 0.1)
code_block = CodeBlock(x=number_slider, y=number_slider_2)
# ---------- code_block.designscript (10 lines) ----------
srs = 1..50..5;
grid = Flatten(Autodesk.Point.ByCoordinates(srs<1>,srs<2>,0));

attractor = Autodesk.Point.ByCoordinates(x,y,0);

dist = attractor.DistanceTo(grid);

topPt = grid.Add(Autodesk.Vector.ByCoordinates(0,0,dist/2));

Autodesk.Cylinder.ByPointsRadius(grid,topPt,dist/15);
# ----------------------------------------
