# Dynamo graph 02 Perforated Screen START.dyn (Dynamo 0.8.1.1942)

code_block = CodeBlock()
# ---------- code_block.designscript (14 lines) ----------
// Bottom curve
pts = {Autodesk.Point.ByCoordinates(0,0,0),
Autodesk.Point.ByCoordinates(7,2,0),
Autodesk.Point.ByCoordinates(20,-2,0)};

bottom = Autodesk.NurbsCurve.ByPoints(pts);

// Top curve
top = Autodesk.Line.ByStartPointEndPoint(
Autodesk.Point.ByCoordinates(0,0,12),
Autodesk.Point.ByCoordinates(20,0,12));

// Surface
Autodesk.Surface.ByLoft({bottom,top});
# ----------------------------------------
code_block_2 = CodeBlock()
# ---------- code_block_2.designscript (14 lines) ----------
// Find the midpoints of 'num' divisions of a range
//
// For dividing a domain into 3 parts (num=3),
// as with the top row, this definition returns
// the midpoints of those blocks, as on the bottom:
//
//   [0]........[1/3].......[2/3]........[1]
//    |..(0.125)..|...(0.5)...|..(0.875)..|

def SeriesAtHalfCells(num)
{
halfInc = (1/(2*(num+1)));
return = halfInc..(1-halfInc)..#num;
};
# ----------------------------------------
