# Dynamo graph Perforations by image.dyn (Dynamo 0.8.1.1942)

code_block = CodeBlock()
# ---------- code_block.designscript (14 lines) ----------
// Find the midpoints of 'num' divisions of a range
//
// For dividing a domain into 3 parts (num=3),
// as with the top row, this definition returns
// the midpoints of those blocks, as on the bottom:
//
//   [0]........[1/3].......[2/3]........[1]
//    |..(0.125)..|...(0.5)...|..(0.875)..|

def SeriesAtHalfCells(num)
{
halfInc = (1/(2*(num+1)));
return = halfInc..(1-halfInc)..#num;
};
# ----------------------------------------
code_block_2 = CodeBlock()
# ---------- code_block_2.designscript (14 lines) ----------
// Bottom curve
pts = {Point.ByCoordinates(0,0,0),
Point.ByCoordinates(7,2,0),
Point.ByCoordinates(20,-2,0)};

bottom = NurbsCurve.ByPoints(pts);

// Top curve
top = Line.ByStartPointEndPoint(
Point.ByCoordinates(0,0,12),
Point.ByCoordinates(20,0,12));

// Surface
Surface.ByLoft({bottom,top});
# ----------------------------------------
x_samples = IntegerSlider(20, range=1..40 step 1)
y_samples = IntegerSlider(10, range=1..40 step 1)

# group: Find planes parallel to the surface at each pixel point on the surface.
code_block_3 = CodeBlock(numX=x_samples, numY=y_samples) { SeriesAtHalfCells(numX); SeriesAtHalfCells(numY); }
pointAtParameter = Surface.PointAtParameter(surface=code_block_2.out3, u=code_block_3.out0, v=code_block_3.out1, lacing=CrossProduct)
normalAtParameter = Surface.NormalAtParameter(surface=code_block_2.out3, u=code_block_3.out0, v=code_block_3.out1, lacing=CrossProduct)
tangentAtUParameter = Surface.TangentAtUParameter(code_block_2.out3, code_block_3.out0, code_block_3.out1, lacing=CrossProduct)
byOriginNormalXAxis = Plane.ByOriginNormalXAxis(origin=pointAtParameter, normal=normalAtParameter, xAxis=tangentAtUParameter)

file_path = Filename("C:\Users\mccronc\Desktop\Workshop\04 Geometry and Images\gradient.jpg")
fromPath = FileObject(file_path)  # "File.FromPath"
readFromFile = Image.ReadFromFile(fromPath)

# group: Massage the date to get it into the same format as the the way the surface is parameterized
pixels = Image.Pixels(image=readFromFile, xSamples=x_samples, ySamples=y_samples)
brightness = Color.Brightness(pixels)
reverse = List.Reverse(brightness)
transpose = List.Transpose(reverse)

# group: Find planar circles representing the holes
code_block_4 = CodeBlock { 0.1; 0.5; }
# note: Tune the radii of the circles.
remapRange = Math.RemapRange(numbers=transpose, newMin=code_block_4.out0, newMax=code_block_4.out1)
byPlaneRadius = Circle.ByPlaneRadius(plane=byOriginNormalXAxis, radius=remapRange)

# group: Extrude the circles into cylinders which pass through the surface
translate = Geometry.Translate(geometry=byPlaneRadius, direction=normalAtParameter)
reverse_2 = Vector.Reverse(normalAtParameter)
code_block_5 = CodeBlock { 2; }
scale = Vector.Scale(vector=reverse_2, scale_factor=code_block_5)
extrudeAsSolid = Curve.ExtrudeAsSolid(curve=translate, direction=scale)

# group: Cut the cylinders from the surface
flatten = Flatten(extrudeAsSolid)
byUnion = Solid.ByUnion(flatten)
subtractFrom = Surface.SubtractFrom(surface=code_block_2.out3, trimmingEntity=byUnion)

# group: Import into Revit
byGeometries = ImportInstance.ByGeometries(subtractFrom)
