# Dynamo graph 02 Reorient Seats.dyn (Dynamo 0.8.1.1942)

# note: Select the surface that will act as the sloped floor plane for the auditorium.
select_face = DSFaceSelection()  # 1 picked in the model
firstItem = List.FirstItem(select_face)
# note: Select the front edge of the surface in Revit.
select_edge = DSEdgeSelection()  # 1 picked in the model
# note: Select the speaker (the little man!)
select_model_element = DSModelElementSelection()  # 1 picked in the model
location = FamilyInstance.Location(select_model_element)

# group: Collect Inputs
# note: Auditorium geometry
code_block = CodeBlock(baseSurface=firstItem) { baseSurface; }
code_block_2 = CodeBlock(frontEdge=select_edge) { frontEdge; }
horiz_distance_btw_rows = LengthFromString(1.524)
# note: Seating info
allowed_chair_width = LengthFromString(0.5588)
family_types = FamilyTypes("chairPointer:chairPointer")
# note: Podium location
code_block_3 = CodeBlock(focalPoint=location) { focalPoint; }

# group: Base curves for seating rows
code_block_4 = CodeBlock(baseSurface=code_block, frontEdge=code_block_2, horizRowDist=horiz_distance_btw_rows)
# ---------- code_block_4.designscript (4 lines) ----------
// Inputs
baseSurface;
frontEdge;
horizRowDist;
# ----------------------------------------
code_block_5 = CodeBlock { 10; }
byCoordinates = Vector.ByCoordinates(z=code_block_5)
extrude = Curve.Extrude(code_block_4.frontEdge, byCoordinates)
code_block_6 = CodeBlock(dist=code_block_4.horizRowDist) { dist * (0..7); }
offset = Surface.Offset(extrude, code_block_6)
intersect = Geometry.Intersect(geometry=code_block_4.baseSurface, other=offset)
flatten = Flatten(intersect)
# note: Remove empty lists (for intersection events that have no solution)
clean = List.Clean(list=flatten)
code_block_7 = CodeBlock(rowCurves=clean)
# ---------- code_block_7.designscript (2 lines) ----------
// Outputs
rowCurves;
# ----------------------------------------

# group: Base points for seats
pointAtDistance = Curve.PointAtDistance()
code_block_8 = CodeBlock(rowCurves=code_block_7, chairWidth=allowed_chair_width)
# ---------- code_block_8.designscript (3 lines) ----------
// Inputs
rowCurves;
chairWidth;
# ----------------------------------------
length = Curve.Length(code_block_8.rowCurves)
div = length / code_block_8.chairWidth
floor = Math.Floor(div)
div_2 = length / floor
code_block_9 = CodeBlock(increment=div_2, numSeats=floor) { increment..#numSeats..increment; }
combine = List.Combine(pointAtDistance, code_block_8.rowCurves, code_block_9)
code_block_10 = CodeBlock(basePoints=combine, seatDistances=code_block_9)
# ---------- code_block_10.designscript (3 lines) ----------
// Outputs
basePoints;
seatDistances;
# ----------------------------------------

# group: Orient the seats according to the row curve
tangentAtParameter = Curve.TangentAtParameter()
code_block_11 = CodeBlock(basePoints=code_block_10.basePoints, seatDistances=code_block_10.seatDistances, rowCurves=code_block_7)
# ---------- code_block_11.designscript (4 lines) ----------
// Inputs
basePoints;
seatDistances;
rowCurves;
# ----------------------------------------
# note: Uncheck "use default parameter"
# for distance input
parameterAtDistance = Curve.ParameterAtDistance()
combine_2 = List.Combine(parameterAtDistance, code_block_11.rowCurves, code_block_11.seatDistances)
combine_3 = List.Combine(tangentAtParameter, code_block_11.rowCurves, combine_2)
ZAxis = Vector.ZAxis()
code_block_12 = CodeBlock { -90; }
rotate = Vector.Rotate(combine_3, ZAxis, code_block_12)
add = Point.Add(point=code_block_11.basePoints, vectorToAdd=rotate)
code_block_13 = CodeBlock(forwardVector=rotate, forwardPoint=add)
# ---------- code_block_13.designscript (3 lines) ----------
// Outputs
forwardVector;
forwardPoint;
# ----------------------------------------

# group: Place seating instances
create = List.Create()
code_block_14 = CodeBlock(basePoint=code_block_10.basePoints, orientationPoint=code_block_13.forwardPoint, seatingFamily=family_types)
# ---------- code_block_14.designscript (4 lines) ----------
// Inputs
basePoint;
orientationPoint;
seatingFamily;
# ----------------------------------------
combine_4 = List.Combine(create, code_block_14.basePoint, code_block_14.orientationPoint)
transpose = List.Transpose()
# note: Adjust the lists to create groups of two points, one group per chair.
map = List.Map(list=combine_4, f_x=transpose)
byPoints = AdaptiveComponent.ByPoints(arg1=code_block_14.seatingFamily)
map_2 = List.Map(f_x=byPoints)
# note: The placed chair elements themselves
map_3 = List.Map(list=map, f_x=map_2)
code_block_15 = CodeBlock(seatingInstances=map_3)
# ---------- code_block_15.designscript (2 lines) ----------
// Outputs
seatingInstances;
# ----------------------------------------

# group: Orient seats toward the speaker position
code_block_16 = CodeBlock(basePoints=code_block_10.basePoints, speakerPoint=code_block_3)
# ---------- code_block_16.designscript (3 lines) ----------
// Inputs
basePoints;
speakerPoint;
# ----------------------------------------
byTwoPoints = Vector.ByTwoPoints(start=code_block_16.basePoints, end=code_block_16.speakerPoint)
X = Vector.X(byTwoPoints)
Y = Vector.Y(byTwoPoints)
boolean = BoolSelector(true)
byCoordinates_2 = Vector.ByCoordinates(x=X, y=Y, normalized=boolean)
add_2 = Point.Add(point=code_block_16.basePoints, vectorToAdd=byCoordinates_2)
code_block_17 = CodeBlock(speakerVector=byCoordinates_2, speakerPoint=add_2)
# ---------- code_block_17.designscript (3 lines) ----------
// Outputs
speakerVector;
speakerPoint;
# ----------------------------------------

dynamoTutorial_TestOrientation = Custom[DynamoTutorial_TestOrientation](basePoint=code_block_10.basePoints, orientationPoint=code_block_17.speakerPoint)  # Test the orientation of two points
dynamoTutorial_TestOrientation_2 = Custom[DynamoTutorial_TestOrientation](basePoint=code_block_10.basePoints, orientationPoint=code_block_13.forwardPoint)
