# Dynamo graph 05 Analyze Sightlines.dyn (Dynamo 0.8.1.1942)

# note: Select the surface that will act as the sloped floor plane for the auditorium.
select_face = DSFaceSelection()  # 1 picked in the model
firstItem = List.FirstItem(select_face)
# note: Select the front edge of the surface in Revit.
select_edge = DSEdgeSelection()  # 1 picked in the model
# note: Select the speaker (the little man!)
select_model_element = DSModelElementSelection()  # 1 picked in the model
location = FamilyInstance.Location(select_model_element)

# group: Collect Inputs
# note: Auditorium geometry
code_block = CodeBlock(baseSurface=firstItem) { baseSurface; }
code_block_2 = CodeBlock(frontEdge=select_edge) { frontEdge; }
horiz_distance_btw_rows = LengthFromString(1.524)
# note: Seating info
allowed_chair_width = LengthFromString(0.5588)
family_types = FamilyTypes("chairPointer:chairPointer")
# note: Podium location
code_block_3 = CodeBlock(focalPoint=location) { focalPoint; }

# group: Base curves for seating rows
code_block_4 = CodeBlock(baseSurface=code_block, frontEdge=code_block_2, horizRowDist=horiz_distance_btw_rows)
# ---------- code_block_4.designscript (4 lines) ----------
// Inputs
baseSurface;
frontEdge;
horizRowDist;
# ----------------------------------------
code_block_5 = CodeBlock { 10; }
byCoordinates = Vector.ByCoordinates(z=code_block_5)
extrude = Curve.Extrude(code_block_4.frontEdge, byCoordinates)
code_block_6 = CodeBlock(dist=code_block_4.horizRowDist) { dist * (0..7); }
offset = Surface.Offset(extrude, code_block_6)
intersect = Geometry.Intersect(geometry=code_block_4.baseSurface, other=offset)
flatten = Flatten(intersect)
# note: Remove empty lists (for intersection events that have no solution)
clean = List.Clean(list=flatten)
code_block_7 = CodeBlock(rowCurves=clean)
# ---------- code_block_7.designscript (2 lines) ----------
// Outputs
rowCurves;
# ----------------------------------------

# group: Base points for seats
pointAtDistance = Curve.PointAtDistance()
code_block_8 = CodeBlock(rowCurves=code_block_7, chairWidth=allowed_chair_width)
# ---------- code_block_8.designscript (3 lines) ----------
// Inputs
rowCurves;
chairWidth;
# ----------------------------------------
length = Curve.Length(code_block_8.rowCurves)
div = length / code_block_8.chairWidth
floor = Math.Floor(div)
div_2 = length / floor
code_block_9 = CodeBlock(increment=div_2, numSeats=floor) { increment..#numSeats..increment; }
combine = List.Combine(pointAtDistance, code_block_8.rowCurves, code_block_9)
code_block_10 = CodeBlock(basePoints=combine, seatDistances=code_block_9)
# ---------- code_block_10.designscript (3 lines) ----------
// Outputs
basePoints;
seatDistances;
# ----------------------------------------

# group: Orient the seats according to the row curve
tangentAtParameter = Curve.TangentAtParameter()
code_block_11 = CodeBlock(basePoints=code_block_10.basePoints, seatDistances=code_block_10.seatDistances, rowCurves=code_block_7)
# ---------- code_block_11.designscript (4 lines) ----------
// Inputs
basePoints;
seatDistances;
rowCurves;
# ----------------------------------------
parameterAtDistance = Curve.ParameterAtDistance()
combine_2 = List.Combine(parameterAtDistance, code_block_11.rowCurves, code_block_11.seatDistances)
combine_3 = List.Combine(tangentAtParameter, code_block_11.rowCurves, combine_2)
ZAxis = Vector.ZAxis()
code_block_12 = CodeBlock { -90; }
rotate = Vector.Rotate(combine_3, ZAxis, code_block_12)
add = Point.Add(point=code_block_11.basePoints, vectorToAdd=rotate)
code_block_13 = CodeBlock(forwardVector=rotate, forwardPoint=add)
# ---------- code_block_13.designscript (3 lines) ----------
// Outputs
forwardVector;
forwardPoint;
# ----------------------------------------

# group: Place seating instances
create = List.Create()
code_block_14 = CodeBlock(basePoint=code_block_10.basePoints, orientationPoint=code_block_13.forwardPoint, seatingFamily=family_types)
# ---------- code_block_14.designscript (4 lines) ----------
// Inputs
basePoint;
orientationPoint;
seatingFamily;
# ----------------------------------------
combine_4 = List.Combine(create, code_block_14.basePoint, code_block_14.orientationPoint)
transpose = List.Transpose()
# note: Adjust the lists to create groups of two points, one group per chair.
map = List.Map(list=combine_4, f_x=transpose)
byPoints = AdaptiveComponent.ByPoints(arg1=code_block_14.seatingFamily)
map_2 = List.Map(f_x=byPoints)
# note: The placed chair elements themselves
map_3 = List.Map(list=map, f_x=map_2)
code_block_15 = CodeBlock(seatingInstances=map_3)
# ---------- code_block_15.designscript (2 lines) ----------
// Outputs
seatingInstances;
# ----------------------------------------

# group: Number each seat
code_block_16 = CodeBlock(seatingInstances=code_block_15)
# ---------- code_block_16.designscript (2 lines) ----------
// Inputs
seatingInstances;
# ----------------------------------------
code_block_17 = CodeBlock { "Seat Number"; }
add_2 = _ + _
code_block_18 = CodeBlock { "Seat "; }
count = List.Count(code_block_16)
stringSequence = Custom[List.StringSeqByAmount](amount=count)  # "List.StringSequence"; Make a series of the given amount of strings from the set {A, B, C,... Z, A, B,... }. Useful for row names given the number of rows of seats, for example.
add_3 = code_block_18 + stringSequence
code_block_19 = CodeBlock { " "; }
add_4 = add_3 + code_block_19
count_2 = List.Count()
map_4 = List.Map(list=code_block_16, f_x=count_2)
code_block_20 = CodeBlock(x=map_4) { 1..x; }
string_from_object = FromObject(code_block_20)
# note: Unique labels for each chair.
combine_5 = List.Combine(add_2, add_4, string_from_object)
# note: Writes the unique names to the elements.  Note that the list structures for the "element" and "value" inputs match.
setParameterByName = Element.SetParameterByName(element=code_block_16, parameterName=code_block_17, value=combine_5)

# group: Orient seats toward the speaker position
code_block_21 = CodeBlock(basePoints=code_block_10.basePoints, speakerPoint=code_block_3)
# ---------- code_block_21.designscript (3 lines) ----------
// Inputs
basePoints;
speakerPoint;
# ----------------------------------------
byTwoPoints = Vector.ByTwoPoints(start=code_block_21.basePoints, end=code_block_21.speakerPoint)
X = Vector.X(byTwoPoints)
Y = Vector.Y(byTwoPoints)
boolean = BoolSelector(true)
byCoordinates_2 = Vector.ByCoordinates(x=X, y=Y, normalized=boolean)
add_5 = Point.Add(point=code_block_21.basePoints, vectorToAdd=byCoordinates_2)
code_block_22 = CodeBlock(speakerVector=byCoordinates_2, speakerPoint=add_5)
# ---------- code_block_22.designscript (3 lines) ----------
// Outputs
speakerVector;
speakerPoint;
# ----------------------------------------

# group: Override element color in view
code_block_23 = CodeBlock(forwardVector=code_block_13.forwardVector, speakerVector=code_block_22.speakerVector, seatingInstances=code_block_15)
# ---------- code_block_23.designscript (4 lines) ----------
// Inputs
forwardVector;
speakerVector;
seatingInstances;
# ----------------------------------------
flatten_2 = Flatten(code_block_23.seatingInstances)
code_block_24 = CodeBlock { 255; 102; }
byARGB = Color.ByARGB(r=code_block_24.out0, g=code_block_24.out0, b=code_block_24.out0)
byARGB_2 = Color.ByARGB(r=code_block_24.out1)
create_2 = List.Create(byARGB, byARGB_2)
code_block_25 = CodeBlock { {0,1}; }
flatten_3 = Flatten(code_block_23.forwardVector)
flatten_4 = Flatten(code_block_23.speakerVector)
# note: How much does the person in the chair have to turn their head to see the focal point?
angleBetween = Vector.AngleBetween(flatten_3, flatten_4)
code_block_26 = CodeBlock { 0; 1; }
remapRange = Math.RemapRange(numbers=angleBetween, newMin=code_block_26.out0, newMax=code_block_26.out1)
color_range = ColorRange(create_2, code_block_25, remapRange)
# note: Override the element color in the current view.
overrideColorInView = Element.OverrideColorInView(element=flatten_2, color=color_range)

# group: Map Donor data to each seat
code_block_27 = CodeBlock(seatingInstances=code_block_15)  # same code as code_block_16
code_block_28 = CodeBlock { "Donor Name"; "Donation"; }
file_path = Filename("C:\Users\mccronc\Box Sync\Projects\SmithGroupJJR Workshop\04 Seating\DonorList.xlsx")
fromPath = FileObject(file_path)  # "File.FromPath"
code_block_29 = CodeBlock { "Sheet1"; }
readFromFile = Excel.ReadFromFile(file=fromPath, sheetName=code_block_29)
# note: Remove the header row
restOfItems = List.RestOfItems(readFromFile)
transpose_2 = List.Transpose(restOfItems)
code_block_30 = CodeBlock(data=transpose_2) { data[0]; data[1]; }
# note: From the Ampersand package
sortByKey = Custom[List.SortByKey](list=code_block_30.out0, keys=code_block_30.out1)  # Sort a list (or lists) according to the order specified by the key list.
reverse = List.Reverse(sortByKey.sorted_keys)
count_3 = List.Count()
# note: Number of seats in each row.
map_5 = List.Map(list=code_block_27, f_x=count_3)
# note: Donation Amounts grouped by row
chopByLengths = Custom[List.ChopByLengths](list=reverse, subLengthList=map_5)  # Chop a list into sublists given a series of sizes. Remaining list items after the sublists have been filled are discarded. Remaining sublist capacity after list items are exhausted is ignored.
setParameterByName_2 = Element.SetParameterByName(element=code_block_27, parameterName=code_block_28.out1, value=chopByLengths)
# note: Reverse the lists so that the highest-paying donors are near the front.
reverse_2 = List.Reverse(sortByKey.sorted_list)
# note: Donor Names grouped by row
chopByLengths_2 = Custom[List.ChopByLengths](list=reverse_2, subLengthList=map_5)
setParameterByName_3 = Element.SetParameterByName(element=code_block_27, parameterName=code_block_28.out0, value=chopByLengths_2)

dynamoTutorial_TestOrientation = Custom[DynamoTutorial_TestOrientation](basePoint=code_block_10.basePoints, orientationPoint=code_block_22.speakerPoint)  # Test the orientation of two points
dynamoTutorial_TestOrientation_2 = Custom[DynamoTutorial_TestOrientation](basePoint=code_block_10.basePoints, orientationPoint=code_block_13.forwardPoint)
