# Dynamo graph surface.dyn (Dynamo 0.8.1.1942)

select_model_element = DSModelElementSelection()  # 1 picked in the model

# group: nothing
# note: Element.Geometry does not return geometry whether the import instance is referenced directly or selected from the project.
geometry = Element.Geometry(select_model_element)

code_block = CodeBlock()
# ---------- code_block.designscript (13 lines) ----------
// Seating floor geometry

pts1 = {Point.ByCoordinates(-20,-8,0),
Point.Origin(),
Point.ByCoordinates(20,-8,0)};
crv1 = NurbsCurve.ByPoints(pts1);

height = 10;
pts2 = {Point.ByCoordinates(-30,27,height),
Point.ByCoordinates(30,27,height)};
crv2 = NurbsCurve.ByPoints(pts2);

Surface.ByLoft({crv1,crv2});
# ----------------------------------------
byGeometries = ImportInstance.ByGeometries(code_block.out5)

# group: nothing
geometry_2 = Element.Geometry(byGeometries)
